vi "Function_2.gviweb"   [LabVIEW NXG 3.0.0]
panel indicators:
  "message": string
uses:
  NI::Skyline::Configuration::Open Configuration.gvi
  NI::Skyline::MessageHTTP::Open.gvi
  NI::Skyline::MessageHTTP::Subscribe.gvi
  NI::Skyline::MessageHTTP::Read.gvi
diagram:
  call "Open Configuration.gvi"(server url="http://localhost:9090", username="admin", password="admin") -> (configuration=w1, error out=w2)
  call "Open.gvi"(error in=w2, configuration=w1) -> (message session out=w3, error out=w4)
  call "Subscribe.gvi"(message session=w3, topic="waveform", error in=w4) -> (message session out=w5, error out=w6)
  while {
    call "Read.gvi"(message session=w5, error in=w6) -> (message=w7)
    $message <- w7
    stop if FALSE
  }
