vi "Get Tester Status.gviweb"   [LabVIEW NXG 3.0.0]
inputs:
  "Configuration": "Configuration.gtype"
outputs:
  "Testers": T1[]
panel indicators:
  "properties": "TagProperty.gtype"[]
types:
  T1 = cluster{"System": string, "Connection": string, "Test Program": string, "UUT": string, "Status": string, "Last Updated": string, "Queue": f64}
  "Client Handle.gtype" = u32
  "Configuration.gtype" = cluster{"Server URL": string, "Session": "Client Handle.gtype"}
  "TagProperty.gtype" = cluster{"key": string, "value": string}
uses:
  WebApp::Filter Systems by Package.gviweb
  WebApp::Active Jobs.gviweb
  NI::Skyline::TagHTTP::Open Tag.gvi
  NI::Skyline::TagHTTP::Read Tag (String).gvi
  NI::Skyline::TagHTTP::Read Tag Settings.gvi
  WebApp::Get Prop.gviweb
  NI::Skyline::TagHTTP::Close Tag (Single).gvi
diagram:
  call "Filter Systems by Package.gviweb"(configuration in=$Configuration, package="ni-teststandexecutor") -> (configuration out=w1, systems=w2)
  Sort 1D Array(array=w2) -> (sorted array=w3)
  for {
    w4 = each element of w3
    Property Node(instance in=w4) -> ("id"=w6, "grains:data:host"=w7, "connected:state"=w8)
    case (w8) {
      frame 0, Default {
        w9 = "Disconnected"
      }
      frame 1 {
        w9 = "Connecting"
      }
      frame 2 {
        w9 = "Connected"
      }
    }
    call "Active Jobs.gviweb"(configuration in=w1, minion id=w6) -> (configuration out=w10, minion id out=w11, jobs in progress=w12)
    Concatenate Strings(w11, ".TestMonitor.0.Status") -> w13
    call "Open Tag.gvi"(path=w13, data type="String", configuration=w10) -> (tag out=w14, error out=w15)
    call "Read Tag (String).gvi"(tag in=w14, error in=w15) -> (tag out=w16, value=w17, time stamp=w18, error out=w19)
    Format Date Time String(time stamp=w18) -> (date/time string=w20)
    call "Read Tag Settings.gvi"(tag in=w16, error in=w19) -> (tag out=w21, properties=w22, error out=w23)
    call "Get Prop.gviweb"(properties=w22, key="nitmProgramName") -> (value=w24)
    call "Get Prop.gviweb"(properties=w22, key="nitmSerialNumber") -> (value=w25)
    Build Cluster(w7, w9, w24, w25, w17, w20, w12) -> w26
    $properties <- w22
    call "Close Tag (Single).gvi"(tag=w21, error in=w23)
    append w26 to w5
  }
  $Testers <- w5
