vi "Main.gviweb"   [LabVIEW NXG 3.0.0]
panel controls:
  "Run Sequence": bool
  "Simulate Failure": enum{"None", "Keyboard", "Video", "Power"} = "None"
  "Amplitude": f64 = 10
  "Automatically pick a system": bool
  "System": i32
  "Test": i32
  "Email": string
panel indicators:
  "Data Grid": T1[]
  "Parameters": i32
  "loop iteration": i32
  "error out": error
types:
  T1 = cluster{"System": string, "Connection": string, "Test Program": string, "UUT": string, "Status": string, "Last Updated": string, "Queue": f64}
uses:
  NI::Skyline::Configuration::Open Configuration.gvi
  WebApp::Get Tester Status.gviweb
  WebApp::Pick System.gviweb
  WebApp::Get Minion ID.gviweb
  WebApp::Filter Systems by Package.gviweb
diagram:
  w1 = TRUE  # Development
  case (w1) {
    frame False, Default {
      # Set Development boolean to False in order to
      # clear server, username, and password
      # before building and deploying the application
      # to your web server or SystemLink.
      w5 = ""  # Server
      w6 = ""  # Username
      w7 = ""  # Password
      w2 = w7
      w3 = w6
      w4 = w5
    }
    frame True {
      # Set Development boolean to True and
      # change the server, username, and password
      # to match your web server.  Also, ensure that CORS
      # is enabled on your web server before trying to
      # interactively run your application from within NXG.
      w8 = "http://demo.systemlink.io"  # Server
      w9 = "admin"  # Username
      w10 = "labview==="  # Password
      w2 = w10
      w3 = w9
      w4 = w8
    }
  }
  call "Open Configuration.gvi"(server url=w4, username=w3, password=w2) -> (configuration=w11, error out=w12)
  while (iteration -> i1) {
    $"loop iteration" <- i1
    call "Get Tester Status.gviweb"(Configuration=w11, error in=no error) -> (Testers=w13, error out=w14)
    $"Data Grid" <- w13
    Wait(time to wait=1000)
    $"error out" <- w14
    stop if FALSE
  }
  call "Test Plans.gviweb"(Input=reference to "Test", error in=w12) -> (Test Plans=w15, Error Out=w16)
  s1 = 1  # shift register
  while {
    event (timeout = s1) {
      on "Run Sequence" Value changed {
        Property Node(instance in=reference to "Test") -> ("Value"=w17)
        Array Index(array=w15) -> (out0[w17]=w18)
        Property Node(instance in=w18) -> ("Test"=w19)
        # Sequence must be some where in the TestStand path like C:\Users\Public\Documents\TestSequences
        case ($"Automatically pick a system") {
          frame True {
            call "Pick System.gviweb"(configuration in=w11, sequence=w19, error in=w16) -> (configuration out=w21, minion id=w20, error out=w22)
          }
          frame False {
            Property Node(instance in=reference to "System") -> ("Items"=w23)
            Array Index(array=w23) -> (out0[$System]=w24)
            call "Get Minion ID.gviweb"(configuration in=w11, hostname=w24, error in=w16) -> (configuration out=w21, id=w20, error out=w22)
          }
        }
        case (w19) {
          frame Default {
            w25 = "[]"
          }
          frame "Computer Motherboard Tests.seq" {
            case ($"Simulate Failure") {
              frame "None", Default {
                w25 = ""
              }
              frame "Keyboard" {
                w25 = "Keyboard=5"
              }
              frame "Video" {
                w25 = "Video=12"
              }
              frame "Power" {
                w25 = "PowerFail=True"
              }
            }
          }
          frame "Power Test.seq" {
            Number To Fractional String(number=$Amplitude, precision (6)=2) -> (F-format string=w26)
            Concatenate Strings("Amplitude=", w26) -> w25
          }
        }
        Concatenate Strings("EmailAddress=", $Email) -> w27
        Build Array(w25, w27) -> w28
        Flatten To JSON(anything=w28) -> (JSON string=w29)
        call "Run Sequence.gviweb"(configuration=w21, minion ID=w20, sequence=w19, args=w29, error in=w22, timeout=600) -> (error out=w30)
      }
      on "Test" Value changed; Timeout {
        Array Index(array=w15) -> (out0[$Test]=w31)
        Property Node(instance in=w31) -> ("Package"=w32)
        call "Filter Systems by Package.gviweb"(configuration in=w11, package=w32) -> (systems=w33)
        for {
          w34 = each element of w33
          Property Node(instance in=w34) -> ("grains:data:host"=w36)
          append w36 to w35
        }
        Sort 1D Array(array=w35) -> (sorted array=w37)
        Property Node(instance in=reference to "System", "Items"=w37)
        $Parameters <- $Test
      }
      on "Automatically pick a system" Value changed {
        Event Data() -> ("New Value"=w38)
        Property Node(instance in=reference to "System", "Disabled"=w38)
      }
    }
    next s1 = -1
    stop if FALSE
  }
