vi "Active Jobs.gviweb"   [LabVIEW NXG 2.1.0]
inputs:
  "configuration in": "Configuration.gtype"
  "minion id": string
  "error in": error
outputs:
  "configuration out": "Configuration.gtype"
  "jobs in progress": i32
  "error out": error
  "minion id out": string
types:
  "Client Handle.gtype" = u32
  "Configuration.gtype" = cluster{"Server URL": string, "Session": "Client Handle.gtype"}
  T1 = cluster{"_id": cluster{"$oid": string}, "id": string, "state": i32}
uses:
  NI::HTTP::POST Buffer.gvi
diagram:
  $"configuration out" <- $"configuration in"
  Property Node(instance in=$"configuration in") -> ("Session"=w1, "Server URL"=w2)
  Concatenate Strings(w2, "/nisysmgmt/v1/systems/managed/jobs/query") -> w3
  w4 = """{  
   "filter":{  
      "$and":[  
         {  
            "$or":[  
               {  
                  "conf.kwargs.metadata._hidden":{  
                     "$exists":false
                  }
               },
               {  
                  "conf.kwargs.metadata._hidden":false
               }
            ]
         },
         {  
            "$or":[  
               {  
                  "state":{  
                     "$in":[  
                        2,
                        3
                     ]
                  }
               }
            ]
         },
         {  
            "id":""""
  w5 = "\"\n         }\n      ]\n   },\n   \"projection\":{  \n      \"id\":true,\n      \"state\":true\n   }\n}"
  Concatenate Strings(w4, $"minion id", w5) -> w6
  call "POST Buffer.gvi"(client handle=w1, url=w3, buffer=w6, error in=$"error in") -> (body=w7, error out=w8)
  w9 = cluster{"status_code": i32, "result": T1[]} {all zero or empty}
  Unflatten From JSON(JSON string=w7, type and defaults=w9) -> (value=w10)
  Property Node(instance in=w10) -> ("result"=w11)
  Array Size(array=w11) -> (size(s)=w12)
  $"jobs in progress" <- w12
  $"error out" <- w8
  $"minion id out" <- $"minion id"
