vi "Filter Systems by Package.gviweb"   [LabVIEW NXG 3.0.0]
inputs:
  "configuration in": "Configuration.gtype"
  "package": string
  "error in": error
outputs:
  "error out": error
  "systems": T1[]
  "configuration out": "Configuration.gtype"
panel indicators:
  "id": string[]
types:
  "Client Handle.gtype" = u32
  "Configuration.gtype" = cluster{"Server URL": string, "Session": "Client Handle.gtype"}
  T1 = cluster{"id": string, "_id": cluster{"$oid": string}, "grains": cluster{"data": cluster{"host": string}}, "connected": cluster{"state": i32}}
uses:
  NI::HTTP::POST Buffer.gvi
diagram:
  w1 = cluster{"status_code": i32, "result": T1[]} {all zero or empty}
  Property Node(instance in=$"configuration in") -> ("Session"=w2, "Server URL"=w3)
  Concatenate Strings(w3, "/nisysmgmt/v1/systems/managed/query") -> w4
  w5 = """" : {"$exists" : true }
   },
   "projection":{  
      "id":true,
      "grains.data.host":true,
      "connected.state":true
   }
}"""
  Concatenate Strings("{  \n   \"filter\":{ \"packages.data.", $package, w5) -> w6
  call "POST Buffer.gvi"(client handle=w2, url=w4, buffer=w6, error in=$"error in") -> (body=w7, error out=w8)
  Unflatten From JSON(JSON string=w7, default null elements=TRUE, error in (no error)=w8, type and defaults=w1) -> (error out=w9, value=w10)
  Property Node(instance in=w10) -> ("result"=w11)
  $systems <- w11
  $"configuration out" <- $"configuration in"
  for {
    w12 = each element of w11
    Property Node(instance in=w12) -> ("id"=w14, "grains:data:host"=w15, "connected:state"=w16)
    append w14 to w13
  }
  $id <- w13
  $"error out" <- w9
