vi "Get Minion ID.gviweb"   [LabVIEW NXG 2.1.0]
inputs:
  "hostname": string
  "configuration in": "Configuration.gtype"
  "error in": error
outputs:
  "id": string
  "configuration out": "Configuration.gtype"
  "error out": error
types:
  "Client Handle.gtype" = u32
  "Configuration.gtype" = cluster{"Server URL": string, "Session": "Client Handle.gtype"}
  T1 = cluster{"id": string, "_id": cluster{"$oid": string}}
uses:
  NI::HTTP::POST Buffer.gvi
diagram:
  $"configuration out" <- $"configuration in"
  Property Node(instance in=$"configuration in") -> ("Session"=w1, "Server URL"=w2)
  Concatenate Strings(w2, "/nisysmgmt/v1/systems/managed/query") -> w3
  w4 = "{  \n   \"filter\":{  \n      \"grains.data.host\":  \n            \""
  w5 = "\"\n   },\n   \"projection\":{  \n      \"id\":true\n   }\n}"
  Concatenate Strings(w4, $hostname, w5) -> w6
  call "POST Buffer.gvi"(client handle=w1, url=w3, buffer=w6, error in=$"error in") -> (body=w7, error out=w8)
  w9 = cluster{"status_code": i32, "result": T1[]} {all zero or empty}
  Unflatten From JSON(JSON string=w7, default null elements=TRUE, error in (no error)=w8, type and defaults=w9) -> (error out=w10, value=w11)
  Property Node(instance in=w11) -> ("result"=w12)
  Array Index(array=w12) -> (out0[_]=w13)
  Property Node(instance in=w13) -> ("id"=w14)
  $id <- w14
  $"error out" <- w10
