vi "Get Package Name.gviweb"   [LabVIEW NXG 3.1.0]
inputs:
  "sequence": string
outputs:
  "package": string
  "found": bool
diagram:
  w1 = [["Computer Motherboard Tests.seq", "ni-computermotherboardtests"], ["Power Test.seq", "ni-power-test"], ["Manufacturing Test.seq", "manufactutring-test-demo-headless"]]  # Package names based on sequence
  Array Size(array=w1) -> (size(s)=w2)
  Array Index(array=w2) -> (out0[_]=w3)
  while (iteration -> i1) {
    w4 = each element of w1
    Array Index(array=w4) -> (out0[1]=w5)
    Is Equal(x=w3, y=i1) -> w6
    Array Index(array=w4) -> (out0[_]=w7)
    Is Equal(x=w7, y=$sequence) -> w8
    Logical Or(w8, w6) -> w9
    stop if w9
  }
  $package <- w5
  $found <- w8
