vi "Get Prop.gviweb"   [LabVIEW NXG 3.0.0]
inputs:
  "properties": "TagProperty.gtype"[] = [{"key"="sdd", "value"="ddd"}, {"key"="nitmOperator", "value"="foo2"}]
  "key": string
outputs:
  "value": string
types:
  "TagProperty.gtype" = cluster{"key": string, "value": string}
diagram:
  Array Size(array=$properties) -> (size(s)=w1)
  case (w1) {
    frame 0 {
      w2 = ""
    }
    frame 1, Default {
      while (iteration -> i1) {
        w3 = each element of $properties
        Property Node(instance in=w3) -> ("key"=w4, "value"=w5)
        Is Equal(x=w4, y=$key) -> w6
        Select(s=w6, t=w5, f="") -> w2
        Increment(x=i1) -> w7
        Is Equal(x=w1, y=w7) -> w8
        Logical Or(w8, w6) -> w9
        stop if w9
      }
    }
  }
  $value <- w2
