vi "Get Tester Status.gviweb"   [LabVIEW NXG 3.1.0]
inputs:
  "Configuration": "Configuration.gtype"
  "error in": error
outputs:
  "Testers": T1[]
  "error out": error
panel indicators:
  "properties": "TagProperty.gtype"[]
types:
  T1 = cluster{"System": string, "Connection": string, "Test Program": string, "UUT": string, "Status": string, "Last Updated": string, "Queue": f64}
  "Client Handle.gtype" = u32
  "Configuration.gtype" = cluster{"Server URL": string, "Session": "Client Handle.gtype"}
  "TagProperty.gtype" = cluster{"key": string, "value": string}
uses:
  WebApp::Filter Systems by Package.gviweb
  WebApp::Active Jobs.gviweb
  NI::Skyline::TagHTTP::Open Tag.gvi
  NI::Skyline::TagHTTP::Read Tag (String).gvi
  NI::Skyline::TagHTTP::Read Tag Settings.gvi
  WebApp::Get Prop.gviweb
  NI::Skyline::TagHTTP::Close Tag (Single).gvi
diagram:
  call "Filter Systems by Package.gviweb"(configuration in=$Configuration, package="ni-teststandexecutor", error in=$"error in") -> (configuration out=w1, systems=w2, error out=w3)
  Sort 1D Array(array=w2) -> (sorted array=w4)
  s1 = w3  # shift register
  for {
    w5 = each element of w4
    Property Node(instance in=w5) -> ("id"=w7, "alias"=w8, "state"=w9)
    case (w9) {
      frame "DISCONNECTED", Default {
        w10 = "Disconnected"
      }
      frame "CONNECTED_REFRESH_PENDING" {
        w10 = "Connecting"
      }
      frame "CONNECTED" {
        w10 = "Connected"
      }
    }
    call "Active Jobs.gviweb"(configuration in=w1, minion id=w7, error in=s1) -> (configuration out=w11, minion id out=w12, jobs in progress=w13, error out=w14)
    Concatenate Strings(w12, ".TestMonitor.0.Status") -> w15
    call "Open Tag.gvi"(path=w15, data type="String", error in=w14, configuration=w11) -> (tag out=w16, error out=w17)
    call "Read Tag (String).gvi"(tag in=w16, error in=w17) -> (tag out=w18, value=w19, time stamp=w20, error out=w21)
    Format Date Time String(time stamp=w20) -> (date/time string=w22)
    call "Read Tag Settings.gvi"(tag in=w18, error in=w21) -> (tag out=w23, properties=w24, error out=w25)
    call "Get Prop.gviweb"(properties=w24, key="nitmProgramName") -> (value=w26)
    call "Get Prop.gviweb"(properties=w24, key="nitmSerialNumber") -> (value=w27)
    Build Cluster(w8, w10, w26, w27, w19, w22, w13) -> w28
    $properties <- w24
    call "Close Tag (Single).gvi"(tag=w23, error in=w25) -> (error out=w29)
    append w28 to w6
    next s1 = w29
  }
  $Testers <- w6
  $"error out" <- s1
