vi "Main.gviweb"   [LabVIEW NXG 2.1.0]
panel controls:
  "Run Sequence": bool
  "System": T2 = "INTEL-NUC-1"
  "Simulate Failure": enum{"None", "Keyboard", "Video", "Power"} = "None"
  "Test": T3 = "Computer Motherboard Tests.seq"
  "Amplitude": f64
panel indicators:
  "Data Grid": T1[]
  "Parameters": i32
types:
  T1 = cluster{"System": string, "Test Program": string, "UUT": string, "Status": string, "Last Updated": string, "Queue": f64}
  T2 = enum{"PXI-ATDEMO-1", "PXI-ATDEMO-2", "PXIe-8840Quad-1", "PXIe-8840Quad-2", "PXIe-8840Quad-3", "INTEL-NUC-1", "INTEL-NUC-2"}
  T3 = enum{"Computer Motherboard Tests.seq", "Power Test.seq"}
  "DataType.gtype" = enum{"Double", "I32", "String", "Boolean", "U64", "Timestamp"}
  "Client Handle.gtype" = u32
  "Configuration.gtype" = cluster{"Server URL": string, "Session": "Client Handle.gtype"}
  "Tag.gtype" = cluster{"Path": string, "Datatype": "DataType.gtype", "Configuration": "Configuration.gtype"}
uses:
  NI::Skyline::Configuration::Open Configuration.gvi
  WebApp::Get Minion ID.gviweb
  NI::Skyline::TagHTTP::Query Tags.gvi
  NI::Skyline::TagHTTP::Multi Read.gvi
  NI::Skyline::TagHTTP::Read Tag Settings.gvi
  WebApp::Get Prop.gviweb
  WebApp::Active Jobs.gviweb
  NI::Skyline::TagHTTP::Close Tag (Multiple).gvi
diagram:
  w1 = TRUE  # Development
  case (w1) {
    frame False, Default {
      # Set Development boolean to False in order to
      # clear server, username, and password
      # before building and deploying the application
      # to your web server or SystemLink.
      w5 = ""  # Server
      w6 = ""  # Username
      w7 = ""  # Password
      w2 = w7
      w3 = w6
      w4 = w5
    }
    frame True {
      # Set Development boolean to True and
      # change the server, username, and password
      # to match your web server.  Also, ensure that CORS
      # is enabled on your web server before trying to
      # interactively run your application from within NXG.
      w8 = "http://demo.systemlink.io"  # Server
      w9 = "admin"  # Username
      w10 = "labview==="  # Password
      w2 = w10
      w3 = w9
      w4 = w8
    }
  }
  call "Open Configuration.gvi"(server url=w4, username=w3, password=w2) -> (configuration=w11)
  while {
    Wait(time to wait=200)
    $Parameters <- $Test
    case ($"Run Sequence") {
      frame True {
        case ($Test) {
          frame Default {
            w12 = "[]"
          }
          frame "Computer Motherboard Tests.seq" {
            case ($"Simulate Failure") {
              frame "None", Default {
                w12 = "[]"
              }
              frame "Keyboard" {
                w12 = "[\"Keyboard=5\"]"
              }
              frame "Video" {
                w12 = "[\"Video=12\"]"
              }
              frame "Power" {
                w12 = "[\"PowerFail=True\"]"
              }
            }
          }
          frame "Power Test.seq" {
            Number To Fractional String(number=$Amplitude, precision (6)=2) -> (F-format string=w13)
            Concatenate Strings("[\"Amplitude=", w13, "\"]") -> w12
          }
        }
        Format Into String($Test) -> w14
        Format Into String($System) -> w15
        # Sequence must be some where in the TestStand path like C:\Users\Public\Documents\TestSequences
        call "Get Minion ID.gviweb"(configuration in=w11, hostname=w15) -> (configuration out=w16, id=w17)
        call "Run Sequence.gviweb"(configuration=w16, minion ID=w17, sequence=w14, args=w12, timeout=600)
      }
      frame False { }
    }
    stop if FALSE
  }
  while {
    Wait(time to wait=1000)
    call "Query Tags.gvi"(paths=["*TestMonitor*"], configuration=w11) -> (tags=w18, error out=w19)
    call "Multi Read.gvi"(tags in=w18, error in=w19) -> (tags out=w20, tag clusters=w21, error out=w22)
    s1 = "Tag.gtype"[] []  # shift register
    for {
      w23 = each element of w20
      w24 = each element of w21
      call "Read Tag Settings.gvi"(tag in=w23, error in=w22) -> (tag out=w26, properties=w27, error out=w28)
      Build Array[ConcatenateInputs=True](s1, w26) -> w29
      Property Node(instance in=w24) -> ("Value"=w30, "Time Stamp"=w31, "Path"=w32)
      Format Date Time String(time stamp=w31) -> (date/time string=w33)
      call "Get Prop.gviweb"(properties=w27, key="nitmHostname") -> (value=w34)
      call "Get Prop.gviweb"(properties=w27, key="nitmProgramName") -> (value=w35)
      call "Get Prop.gviweb"(properties=w27, key="nitmSerialNumber") -> (value=w36)
      Search Or Split String(search string/char=".", string=w32) -> (substring before match=w37)
      call "Active Jobs.gviweb"(configuration in=w11, minion id=w37) -> (jobs in progress=w38)
      Build Cluster(w34, w35, w36, w30, w33, w38) -> w39
      append w39 to w25
      next s1 = w29
    }
    call "Close Tag (Multiple).gvi"(tags=s1, error in=w28)
    $"Data Grid" <- w25
    stop if FALSE
  }
