vi "Pick System.gviweb"   [LabVIEW NXG 3.1.0]
inputs:
  "configuration in": "Configuration.gtype"
  "sequence": string
  "error in": error
outputs:
  "configuration out": "Configuration.gtype"
  "minion id": string
  "queue size": i32
  "error out": error
types:
  "Client Handle.gtype" = u32
  "Configuration.gtype" = cluster{"Server URL": string, "Session": "Client Handle.gtype"}
uses:
  WebApp::Get Package Name.gviweb
  WebApp::Active Jobs.gviweb
diagram:
  call "Get Package Name.gviweb"(sequence=$sequence) -> (package=w1)
  call "Filter Systems by Package.gviweb"(configuration in=$"configuration in", package=w1, error in=$"error in") -> (configuration out=w2, systems=w3, error out=w4)
  s1 = 2147483647  # shift register
  s2 = ""  # shift register
  s3 = w4  # shift register
  for {
    w5 = each element of w3
    Property Node(instance in=w5) -> ("id"=w6, "state"=w7)
    case (w7) {
      frame "DISCONNECTED", Default {
        w8 = s2
        w9 = w2
        w10 = s3
        w11 = s1
      }
      frame "CONNECTED" {
        call "Active Jobs.gviweb"(configuration in=w2, minion id=w6, error in=s3) -> (configuration out=w9, minion id out=w12, jobs in progress=w13, error out=w10)
        Is Less(x=w13, y=s1) -> w14
        case (w14) {
          frame False, Default {
            w8 = s2
            w11 = s1
          }
          frame True {
            w8 = w12
            w11 = w13
          }
        }
      }
    }
    next s1 = w11
    next s2 = w8
    next s3 = w10
  }
  $"configuration out" <- w9
  $"minion id" <- s2
  $"queue size" <- s1
  $"error out" <- s3
