vi "Run Sequence.gviweb"   [LabVIEW NXG 3.0.0]
inputs:
  "configuration": "Configuration.gtype"
  "minion ID": string
  "sequence": string = " \\\"C:\\\\Users\\\\Public\\\\Documents\\\\National Instruments\\\\TestStand 2016 (32-bit)\\\\Examples\\\\Demos\\\\Mobile Device Test\\\\Mobile Device Test.seq\\\""
  "timeout": u32 = 600
  "args": string
  "error in": error
outputs:
  "error out": error
panel indicators:
  "POST Request": string
  "body": string
  "headers": string
types:
  "Client Handle.gtype" = u32
  "Configuration.gtype" = cluster{"Server URL": string, "Session": "Client Handle.gtype"}
uses:
  WebApp::Encode.gviweb
  NI::HTTP::POST Buffer.gvi
diagram:
  Property Node(instance in=$configuration) -> ("Session"=w1, "Server URL"=w2)
  Concatenate Strings(w2, "/nisysmgmt/v1/systems/managed/jobs") -> w3
  w4 = "\"\n   ],\n   \"metadata\":{  \n      \"queued\":true,\n      \"timeout\":"
  w5 = "\n   },\n   \"fun\":\"niteststand_remote_executor.execute\",\n   \"arg\":[\""
  Format Into String(formatString="%d", $timeout) -> w6
  call "Encode.gviweb"(string input=$sequence) -> (string output=w7)
  Concatenate Strings("{  \n   \"tgt\":[  \n      \"", $"minion ID", w4, w6, w5, w7, "\",", $args, "   ]\n}") -> w8
  call "POST Buffer.gvi"(client handle=w1, url=w3, buffer=w8, error in=$"error in") -> (headers=w9, body=w10, error out=w11)
  $headers <- w9
  $body <- w10
  $"error out" <- w11
  $"POST Request" <- w8
