vi "Search and Replace All.gviweb"   [LabVIEW NXG 2.1.0]
inputs:
  "input string": string = "C:\\Program Files\\TestStand Runner\\TestSequence\\Computer Motherboard Test Sequence.seq"
  "search string": string = "\\"
  "replace string": string = "\\\\"
outputs:
  "output string": string
diagram:
  s1 = $"input string"  # shift register
  s2 = 0  # shift register
  while {
    Match Pattern(offset (0)=s2, regular expression=$"search string", string=s1) -> (after substring=w1, before substring=w2, match substring=w3, offset past match=w4)
    Is Empty String Or Path(string/path=w3) -> w5
    Concatenate Strings(w2, $"replace string", w1) -> w6
    Select(s=w5, t=s1, f=w6) -> w7
    Increment(x=w4) -> w8
    next s1 = w7
    next s2 = w8
    stop if w5
  }
  $"output string" <- s1
