vi "Test Plans.gviweb"   [LabVIEW NXG 3.1.0]
inputs:
  "Input": "RingSelectorInt32 reference"
  "error in": error
outputs:
  "Test Plans": cluster{"Test": string, "Package": string}[]
  "Error Out": error
diagram:
  w1 = [{"Test"="Computer Motherboard Tests.seq", "Package"="ni-computermotherboardtests"}, {"Test"="Power Test.seq", "Package"="ni-power-test"}, {"Test"="Manufacturing Test.seq", "Package"="manufactutring-test-demo-headless"}]
  $"Test Plans" <- w1
  for {
    w2 = each element of w1
    Property Node(instance in=w2) -> ("Test"=w4)
    append w4 to w3
  }
  Property Node(instance in=$Input, "Items"=w3, "Value"=0, error in=$"error in") -> (error out=w5)
  $"Error Out" <- w5
